# Grasshopper definition 20201126_Aggregation_add Collison preventation.gh (Grasshopper 1.0.7)
# plug-ins: MeshEdit Components, Anemone, Weaverbird

# ---- group: Collision
geo = Geometry([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])
bbox = BoundingBox(Content=geo, Plane=PlaneXY(0, 0, 0))  # -> Box, Box_2
boxprop = BoxProperties(Box=bbox.Box)  # -> Center, Diagonal, Area, Volume, Degeneracy
geo_2 = Geometry(geo)
pt = Point(boxprop.Center)
loop_start = LoopStart(N=Slider(51, range=0..100), T=Button(), D0=geo_2, D1=pt)  # -> port, Counter, Data, Data_2
random = Random(Range="0 to 10", Number=1, Seed=loop_start.Counter)
round = Round(Number=random)  # -> Nearest, Floor, Ceiling
clean = CleanTree(RemoveNulls=True, RemoveInvalid=True, RemoveEmpty=False, Tree=loop_start.Data)
clean_2 = CleanTree(RemoveNulls=True, RemoveInvalid=True, RemoveEmpty=False, Tree=loop_start.Data_2)
multiplication = Multiplication(A=round.Nearest, B="10")
item = ListItem(List=multiplication, Index=0, Wrap=True)  # -> Item, Item1, Item2
pt_2 = Point(clean_2)
vec = VectorXYZ(XComponent=item.Item, YComponent=item.Item1, ZComponent=item.Item2)  # -> Vector, Length
move = Move(Geometry=pt, Motion=vec.Vector)  # -> Geometry, Transform
graft = GraftTree(Tree=move.Geometry, IncludeEmptyLists=True, IncludeNullItems=True)
dist = Distance(PointA=pt_2, PointB=graft)
smaller = SmallerThan(FirstNumber=dist, SecondNumber="0.1")  # -> SmallerThan, OrEqualTo
flatten = FlattenTree(Tree=smaller.SmallerThan, Path="{0}")
move_2 = Move(Geometry=geo_2, Motion=vec.Vector)  # -> Geometry, Transform
ma = MassAddition(Input=flatten)  # -> Result, PartialResults
merge = Merge(Data1=flatten(clean), Data2=flatten(move_2.Geometry))
merge_2 = Merge(Data1=flatten(clean_2), Data2=flatten(move.Geometry))
bool = Boolean(ma.Result)
filter = StreamFilter(Gate=bool, Stream0=merge_2, Stream1=clean_2)
filter_2 = StreamFilter(Gate=bool, Stream0=merge, Stream1=clean)
loop_end = LoopEnd(port=loop_start.port, Exit=False, Data=filter_2, Data_2=filter, TimeOutVal=0, pausedState=False, state="Constant output")  # -> D0, D1

# ----
srf = Surface([<surface referenced from the Rhino model> x4])
brep = Brep([<brep referenced from the Rhino model> x13])
brep_2 = Brep([<brep referenced from the Rhino model> x8])
srf_2 = Surface([<surface referenced from the Rhino model> x4])
brep_3 = Brep([<brep referenced from the Rhino model> x8])
srf_3 = Surface([<surface referenced from the Rhino model> x4])
boxprop_2 = BoxProperties(Box=brep)  # -> Center, Diagonal, Area, Volume, Degeneracy
boxprop_3 = BoxProperties(Box=brep_2)  # -> Center, Diagonal, Area, Volume, Degeneracy
boxprop_4 = BoxProperties(Box=brep_3)  # -> Center, Diagonal, Area, Volume, Degeneracy
group = Group(Objects=boxprop_2.Center)
group_2 = Group(Objects=srf)
group_3 = Group(Objects=srf_3)
group_4 = Group(Objects=boxprop_3.Center)
group_5 = Group(Objects=srf_2)
group_6 = Group(Objects=boxprop_4.Center)
srf_4 = Surface(<surface referenced from the Rhino model>)
crv = Curve(<curve referenced from the Rhino model>)
crv_2 = Curve(<curve referenced from the Rhino model>)
crv_3 = Curve(<curve referenced from the Rhino model>)
crv_4 = Curve(<curve referenced from the Rhino model>)
srf_5 = Surface(<surface referenced from the Rhino model>)
crv_5 = Curve(<curve referenced from the Rhino model>)
crv_6 = Curve(<curve referenced from the Rhino model>)
srf_6 = Surface(<surface referenced from the Rhino model>)
srf_7 = Surface(<surface referenced from the Rhino model>)
crv_7 = Curve(<curve referenced from the Rhino model>)
crv_8 = Curve(<curve referenced from the Rhino model>)
crv_9 = Curve(<curve referenced from the Rhino model>)
crv_10 = Curve(<curve referenced from the Rhino model>)
crv_11 = Curve(<curve referenced from the Rhino model>)
crv_12 = Curve(<curve referenced from the Rhino model>)
srf_8 = Surface(<surface referenced from the Rhino model>)
srf_9 = Surface(<surface referenced from the Rhino model>)
crv_13 = Curve(<curve referenced from the Rhino model>)
crv_14 = Curve(<curve referenced from the Rhino model>)
crv_15 = Curve(<curve referenced from the Rhino model>)
crv_16 = Curve(<curve referenced from the Rhino model>)
crv_17 = Curve(<curve referenced from the Rhino model>)
crv_18 = Curve(<curve referenced from the Rhino model>)
merge_3 = Merge(
    Data1=group,
    Data2=srf_4,
    Data3=srf_5,
    Data4=crv_5,
    Data5=crv_6,
    Data6=crv,
    Data7=crv_2,
    Data8=crv_3,
    Data9=crv_4,
    Data10=group_2)  # -> flatten(Result)
merge_4 = Merge(
    Data1=group_4,
    Data2=srf_6,
    Data3=srf_7,
    Data4=crv_7,
    Data5=crv_8,
    Data6=crv_9,
    Data7=crv_10,
    Data8=crv_11,
    Data9=crv_12,
    Data10=group_5)  # -> flatten(Result)
merge_5 = Merge(
    Data1=group_6,
    Data2=srf_8,
    Data3=srf_9,
    Data4=crv_13,
    Data5=crv_14,
    Data6=crv_15,
    Data7=crv_16,
    Data8=crv_17,
    Data9=crv_18,
    Data10=group_3)  # -> flatten(Result)
group_7 = Group(Objects=merge_3)
group_8 = Group(Objects=merge_4)
group_9 = Group(Objects=merge_5)
geo_3 = Geometry([group_8, group_9, group_7])

# ---- group: Boxes
brep_4 = Brep([<brep referenced from the Rhino model> x7])

# ---- group: Component Design / Geometry
brep_5 = Brep([<brep referenced from the Rhino model> x7])

# ---- group: Component Design / Joint_Female
brep_6 = Brep(<brep referenced from the Rhino model>)

# ---- group: Plane_Incoming
crv_19 = Curve(reparameterize([<curve referenced from the Rhino model> x14]))

# ---- group: Plane_Receiving
crv_20 = Curve(reparameterize([<curve referenced from the Rhino model> x14]))

# ---- group: Component Design / Joint_Male
brep_7 = Brep(<brep referenced from the Rhino model>)

# ----
brep_8 = Brep([<brep referenced from the Rhino model> x21])  # disabled
crv_21 = Curve(reparameterize([<curve referenced from the Rhino model> x48]))  # disabled

# ---- group: Boxes
brep_9 = Brep([<brep referenced from the Rhino model> x3])

# ---- group: Plane_Incoming
crv_22 = Curve(reparameterize([<curve referenced from the Rhino model> x10]))

# ---- group: Plane_Receiving
crv_23 = Curve(reparameterize([<curve referenced from the Rhino model> x6]))

# ----
curvepoint = PointOnCurve(crv_21, parameter=0.5)  # disabled
lng = ListLength(List=brep_8)  # disabled
bbox_2 = BoundingBox(Content=geo_3, Plane=PlaneXY(0, 0, 0))  # -> Box, Box_2
bbox_3 = BoundingBox(Content=crv_22, Plane=PlaneXY(0, 0, 0))  # -> Box, Box_2
bbox_4 = BoundingBox(Content=crv_23, Plane=PlaneXY(0, 0, 0))  # -> Box, Box_2
graft_2 = GraftTree(Tree=crv_22, IncludeEmptyLists=True, IncludeNullItems=True)
graft_3 = GraftTree(Tree=crv_23, IncludeEmptyLists=True, IncludeNullItems=True)
graft_4 = GraftTree(Tree=brep_8, IncludeEmptyLists=True, IncludeNullItems=True)  # -> simplify(Tree); disabled
brepinc = PointInBrep(Brep=brep_8, Point=graft(curvepoint), Strict=False)  # disabled
graft_5 = GraftTree(Tree=crv_21, IncludeEmptyLists=True, IncludeNullItems=True)  # disabled
series = Series(Start=0, Step=1, Count=lng)  # disabled

join = JoinCurves(Curves=crv_21, Preserve=False)  # -> reparameterize(Curves); disabled
disc = Discontinuity(Curve=join, Level=1)  # -> Points, Parameters; disabled
lng_2 = ListLength(List=disc.Points)  # disabled
panel = Panel("2")  # disabled
larger = LargerThan(FirstNumber=lng_2, SecondNumber=panel)  # -> flatten(LargerThan), OrEqualTo; disabled
dispatch = Dispatch(List=join, DispatchPattern=larger.LargerThan)  # -> ListA, ListB; disabled
panel_2 = Panel("0.5")  # disabled
fillet = Fillet(Curve=dispatch.ListA, Radius=panel_2)  # -> reparameterize(Curve); disabled
panel_3 = Panel("""0
0.25
0.75
1""")  # disabled
panel_4 = Panel("""2
0.5
0.5
2""")  # disabled
# 01
merge_6 = Merge(Data1=fillet, Data2=dispatch.ListB)  # disabled
vpipe = PipeVariable(Curve=reparameterize(graft(merge_6)), Parameters=panel_3, Radii=panel_4, Caps=0)  # -> flatten(Pipe); disabled
bbox_5 = BoundingBox(Content=vpipe, Plane=PlaneXY(0, 0, 0))  # -> Box, Box_2; disabled
boxprop_5 = BoxProperties(Box=bbox_5.Box)  # -> Center, Diagonal, Area, Volume, Degeneracy; disabled
brepinc_2 = PointInBrep(Brep=brep_8, Point=graft(boxprop_5.Center), Strict=False)  # disabled
graft_6 = GraftTree(Tree=vpipe, IncludeEmptyLists=True, IncludeNullItems=True)  # disabled
cull = CullPattern(List=series, CullPattern=brepinc_2)  # disabled
tstat = TreeStatistics(Tree=graft_6)  # -> Paths, Length, Count; disabled
flatten_2 = FlattenTree(Tree=cull, Path="{0}")  # disabled
replace = ReplacePaths(Data=graft_6, Search=tstat.Paths, Replace=flatten_2)  # disabled

volume = MeshVolume(Mesh=bbox_2.Box)  # -> Volume, Centroid
cull_2 = CullPattern(List=series, CullPattern=brepinc)  # disabled
tstat_2 = TreeStatistics(Tree=graft_5)  # -> Paths, Length, Count; disabled
graft_7 = GraftTree(Tree=brep_9, IncludeEmptyLists=True, IncludeNullItems=True)  # -> simplify(Tree)
volume_2 = Volume(Geometry=brep_9)  # -> Volume, Centroid
area = Area(Geometry=bbox_3.Box)  # -> Area, Centroid
area_2 = Area(Geometry=bbox_4.Box)  # -> Area, Centroid
flatten_3 = FlattenTree(Tree=cull_2, Path="{0}")  # disabled
replace_2 = ReplacePaths(Data=graft_5, Search=tstat_2.Paths, Replace=flatten_3)  # disabled
scale = Scale(Geometry=brep_9, Center=volume_2.Centroid, Factor=1.1)  # -> Geometry, Transform
brepinc_3 = PointInBrep(Brep=scale.Geometry, Point=graft(area.Centroid), Strict=False)
brepinc_4 = PointInBrep(Brep=scale.Geometry, Point=graft(area_2.Centroid), Strict=False)
# 01
boxprop_6 = BoxProperties(Box=graft_7)  # -> Center, Diagonal, Area, Volume, Degeneracy
tstat_3 = TreeStatistics(Tree=graft_2)  # -> Paths, Length, Count
tstat_4 = TreeStatistics(Tree=graft_3)  # -> Paths, Length, Count
lng_3 = ListLength(List=brep_9)

# ---- group: Module boxes
box = Box(graft_4)  # disabled

# ---- group: Module skeletons
crv_24 = Curve(replace_2)  # disabled

# ----
series_2 = Series(Start=0, Step=1, Count=lng_3)
pdecon = Deconstruct(Point=volume.Centroid)  # -> XComponent, YComponent, ZComponent
boxprop_7 = BoxProperties(Box=box)  # -> Center, Diagonal, Area, Volume, Degeneracy; disabled
cull_3 = CullPattern(List=series_2, CullPattern=brepinc_3)
flatten_4 = FlattenTree(Tree=cull_3, Path="{0}")
sort = SortList(Keys=pdecon.XComponent, ValuesA=geo_3)  # -> Keys, ValuesA
replace_3 = ReplacePaths(Data=graft_2, Search=tstat_3.Paths, Replace=flatten_4)
disc_2 = Discontinuity(Curve=crv_24, Level=1)  # -> Points, Parameters; disabled
cull_4 = CullPattern(List=series_2, CullPattern=brepinc_4)
flatten_5 = FlattenTree(Tree=cull_4, Path="{0}")
replace_4 = ReplacePaths(Data=graft_3, Search=tstat_4.Paths, Replace=flatten_5)
debrep = DeconstructBrep(Brep=box)  # -> simplify(Faces), Edges, Vertices; disabled
graft_8 = GraftTree(Tree=sort.ValuesA, IncludeEmptyLists=True, IncludeNullItems=True)  # -> simplify(Tree)
pshift = ShiftPaths(Data=disc_2.Points, Offset=-1)  # disabled
pull = PullPoint(Point=pshift, Geometry=debrep.Faces, ClosestOnly=False)  # -> ClosestPoint, Distance; disabled
abs = Absolute(Value=pull.Distance)  # disabled
panel_5 = Panel("0.001")  # disabled
panel_6 = Panel("6")  # disabled
python = GhPythonScript(Poly=replace_3)  # -> out, Plane; inputs Poly: Curve
# ---------- python: Python ----------
__author__ = "Alessio"
__version__ = "2019.09.29"

import rhinoscriptsyntax as rs

def planeFromPolyline(poly=None):
    if poly==None:
        return
    pts = rs.PolylineVertices(poly)
    
    if len(pts) != 3:
        return
    P = rs.PlaneFromPoints(pts[1],pts[0],pts[2])
    return P
    
Plane = planeFromPolyline(Poly)
# ---------- end python ----------
python_2 = GhPythonScript(Poly=replace_4)  # -> out, Plane; inputs Poly: Curve; same code as python
smaller_2 = SmallerThan(FirstNumber=abs, SecondNumber=panel_5)  # -> SmallerThan, OrEqualTo; disabled
series_3 = Series(Start=0, Step=1, Count=panel_6)  # disabled

# ---- group: Points
ungroup = Ungroup(Group=graft_8)
item_2 = ListItem(List=ungroup, Index=0, Wrap=True)

# ---- group: Component geometry
geo_4 = Geometry(graft_8)

# ---- group: Points
ungroup_2 = Ungroup(Group=graft_8)
item_3 = ListItem(List=ungroup_2, Index=[1, 2], Wrap=True)

# ---- group: Module centers
pt_3 = Point(boxprop_6.Center)

# ---- group: Module boxes
box_2 = Box(graft_7)

# ---- group: Incoming connectors
pln = Plane(python.Plane)

# ---- group: Receiving connectors
pln_2 = Plane(python_2.Plane)

# ----
cull_5 = CullPattern(List=series_3, CullPattern=smaller_2.SmallerThan)  # disabled
pshift_2 = ShiftPaths(Data=cull_5, Offset=-1)  # disabled
panel_7 = Panel("{0.5,0.5,0}")  # disabled
evalsrf = EvaluateSurface(Surface=reparameterize(debrep.Faces), Point=panel_7)  # -> Point, Normal, UDirection, VDirection, Frame; disabled
material = CreateMaterial(
    Diffuse=ColourSwatch(SwatchColor=RGB(255, 255, 255)),
    Specular=RGB(255, 255, 255),
    Emission=RGB(0, 0, 0),
    Transparency=Slider(0.863, range=0..1),
    Shine=0)
item_4 = ListItem(List=evalsrf.Frame, Index=pshift_2, Wrap=True)  # disabled
toggle = BooleanToggle(True)  # disabled
toggle_2 = BooleanToggle(False)  # disabled
cull_i = CullIndex(List=evalsrf.Frame, Indices=pshift_2, Wrap=True)  # -> simplify(List); disabled
pflip = FlipPlane(Plane=item_4, ReverseX=toggle, ReverseY=toggle_2, SwapAxes=toggle_2)  # disabled

# ---- group: Module boxes
box_3 = Box(box)  # disabled

# ---- group: Module centers
pt_4 = Point(boxprop_7.Center)  # disabled

# ----
viewer = ParamViewer(pt_4)  # disabled

# ---- group: Module skeletons
crv_25 = Curve(crv_24)  # disabled

# ---- group: Receiving connectors
pln_3 = Plane(item_4)  # disabled

# ---- group: Incoming connectors
pln_4 = Plane(pflip)  # disabled

# ---- group: Non-connectors
pln_5 = Plane(cull_i)  # disabled

# ---- group: Component geometry
geo_5 = Geometry(replace)  # disabled

# ----
group_10 = Group(Objects=geo_5)  # disabled

# ---- group: Choose specific path
number_slider = Slider(1000, range=0..100000)  # disabled
# 02
tstat_5 = TreeStatistics(Tree=pln_4)  # -> Paths, Length, Count; disabled
random_2 = Random(Range=tstat_5.Count, Number=1, Seed=number_slider)  # disabled
int = Integer(random_2)  # disabled
item_5 = ListItem(List=tstat_5.Paths, Index=int, Wrap=True)  # disabled

# ---- group: Initial component placement
crv_26 = Curve(<curve referenced from the Rhino model>)  # disabled
# 03
python_3 = GhPythonScript(Poly=crv_26)  # -> out, Plane; inputs Poly: Curve; disabled; same code as python

crv_27 = Curve(<curve referenced from the Rhino model>)
# 03
python_4 = GhPythonScript(Poly=crv_27)  # -> out, Plane; inputs Poly: Curve; same code as python

# ----
panel_8 = Panel("1")  # disabled
tstat_6 = TreeStatistics(Tree=pln_3)  # -> Paths, Length, Count; disabled
number_slider_2 = Slider(10, range=0..1000)  # disabled
addition = Addition(A=number_slider_2, B=panel_8)  # disabled
number_slider_3 = Slider(50, range=0..1000)
addition_2 = Addition(A=number_slider_3, B="1")
button = Button()  # disabled
panel_9 = Panel("1")  # disabled

# ---- group: 01_First Component Setting / Selected Path_Incoming
branch = TreeBranch(Tree=pln_4, Path=item_5, MaintainPaths=False)  # disabled

# ---- group: 01_First Component Setting / Selected Path_Geometry
branch_2 = TreeBranch(Tree=group_10, Path=item_5, MaintainPaths=False)  # disabled

# ---- group: 01_First Component Setting / Selected Path_Receiving
branch_3 = TreeBranch(Tree=pln_3, Path=item_5, MaintainPaths=False)  # disabled

# ---- group: 01_First Component Setting / Selected Path_Non-Connectors
branch_4 = TreeBranch(Tree=pln_5, Path=item_5, MaintainPaths=False)  # disabled

# ---- group: 01 Initial component placement
number_slider_4 = Slider(81, range=0..1000)  # disabled
number_slider_5 = Slider(130, range=0..1000)  # disabled
number_slider_6 = Slider(21, range=0..1000)  # disabled
number_slider_7 = Slider(140, range=0..1000)  # disabled
number_slider_8 = Slider(109, range=0..1000)  # disabled
number_slider_9 = Slider(146, range=0..1000)  # disabled
pt_5 = ConstructPoint(XCoordinate=number_slider_4, YCoordinate=number_slider_5, ZCoordinate=number_slider_6)  # disabled
vec_2 = VectorXYZ(XComponent=number_slider_7, YComponent=number_slider_8, ZComponent=number_slider_9)  # -> Vector, Length; disabled

# ----
panel_10 = Panel("1")  # disabled

# ---- group: 01 Initial component placement / First receiving plane
# 03
pl = PlaneNormal(Origin=pt_5, ZAxis=vec_2.Vector)  # disabled

# ---- group: 01_First Component Setting
number_slider_10 = Slider(22484, range=0..100000)  # disabled
lng_4 = ListLength(List=branch)  # disabled
# 04
random_3 = Random(Range=lng_4, Number=1, Seed=number_slider_10)  # disabled
item_6 = ListItem(List=branch, Index=random_3, Wrap=True)  # disabled
orient = Orient(Geometry=branch_3, Source=item_6, Target=pl)  # -> Geometry, Transform; disabled
orient_2 = Orient(Geometry=branch_2, Source=item_6, Target=pl)  # -> Geometry, Transform; disabled
orient_3 = Orient(Geometry=branch_4, Source=item_6, Target=pl)  # -> Geometry, Transform; disabled

# ----
panel_11 = Panel("// Inital State //")  # disabled

panel_12 = Panel("// Inital State //")

number_slider_11 = Slider(44, range=0..500)  # disabled
addition_3 = Addition(A=number_slider_11, B=panel_10)  # disabled

# ---- group: Replace RANDOM with something meaningful
number_slider_12 = Slider(43011, range=0..100000)  # disabled
number_slider_13 = Slider(22484, range=0..100000)  # disabled
number_slider_14 = Slider(32470, range=0..100000)  # disabled
random_4 = Random(Range=tstat_6.Count, Number=addition_3, Seed=number_slider_12)  # disabled
random_5 = Random(Range=Domain(0, 1), Number=addition_3, Seed=number_slider_13)  # disabled
random_6 = Random(Range=Domain(0, 1), Number=addition_3, Seed=number_slider_14)  # disabled

# ----
button_2 = Button()  # disabled
panel_13 = Panel("1")  # disabled
loop_start_2 = LoopStart(N=number_slider_11, T=button_2, D0=orient_2.Geometry, D1=orient.Geometry, D2=orient_3.Geometry, D3=panel_13, D4=int)  # -> port, Counter, Data, Data_2, Data_3, Data_4, Data_5; disabled

# ---- group: Placed geometries
geo_6 = Geometry(loop_start_2.Data)  # disabled

# ---- group: Available receiving connectors
pln_6 = Plane(loop_start_2.Data_2)  # disabled

# ---- group: Unavailable receiving connectors
pln_7 = Plane(loop_start_2.Data_3)  # disabled

# ----
swatch = ColourSwatch(SwatchColor=RGB(109, 187, 252))  # disabled
brep_10 = Brep(<brep referenced from the Rhino model>)  # disabled

# ---- group: Exernal Boundary
brep_11 = Brep(<brep referenced from the Rhino model>)

# ----
edges = BrepEdges(Brep=brep_11)  # -> Naked, Interior, NonManifold
preview = CustomPreview(Geometry=edges.Interior, Material=ColourSwatch(SwatchColor=RGB(123, 109, 145)))
panel_15 = Panel("""1
2""")

# ---- group: Choosing Next Path
item_7 = ListItem(List=random_4, Index=loop_start_2.Counter, Wrap=True)  # disabled
int_2 = Integer(item_7)  # disabled
# 05
item_8 = ListItem(List=tstat_6.Paths, Index=int_2, Wrap=True)  # disabled

# ---- group: Next receiving connector
lng_5 = ListLength(List=pln_6)  # disabled
item_9 = ListItem(List=random_6, Index=loop_start_2.Counter, Wrap=True)  # disabled
multiplication_2 = Multiplication(A=lng_5, B=item_9)  # disabled
item_10 = ListItem(List=pln_6, Index=multiplication_2, Wrap=True)  # disabled

# ---- group: New Place Component / Next_incoming
branch_5 = TreeBranch(Tree=pln_4, Path=item_8, MaintainPaths=False)  # disabled

# ---- group: New Place Component / Next_Geometry
branch_6 = TreeBranch(Tree=group_10, Path=item_8, MaintainPaths=False)  # disabled

# ---- group: New Place Component / Next_Receiver
branch_7 = TreeBranch(Tree=pln_3, Path=item_8, MaintainPaths=False)  # disabled

# ---- group: New Place Component / Next_Non Connector
branch_8 = TreeBranch(Tree=pln_5, Path=item_8, MaintainPaths=False)  # disabled

# ----
swatch_2 = ColourSwatch(SwatchColor=RGB(255, 255, 255))  # disabled

# ---- group: Envelope
brep_12 = Brep(<brep referenced from the Rhino model>)  # disabled

# ----
panel_16 = Panel("""0
9""")
panel_17 = Panel("1")  # disabled
panel_18 = Panel("2")  # disabled
panel_19 = Panel("3")  # disabled
panel_20 = Panel("4")  # disabled
panel_21 = Panel("5")  # disabled
panel_22 = Panel("6")  # disabled
brep_13 = Brep(brep_11)
debrep_2 = DeconstructBrep(Brep=brep_13)  # -> Faces, Edges, Vertices
swatch_3 = ColourSwatch(SwatchColor=RGB(139, 99, 108))  # disabled
swatch_4 = ColourSwatch(SwatchColor=RGB(139, 76, 57))  # disabled
swatch_5 = ColourSwatch(SwatchColor=RGB(255, 181, 197))  # disabled
swatch_6 = ColourSwatch(SwatchColor=RGB(205, 145, 158))  # disabled
swatch_7 = ColourSwatch(SwatchColor=RGB(255, 140, 105))  # disabled
swatch_8 = ColourSwatch(SwatchColor=RGB(205, 112, 84))  # disabled
swatch_9 = ColourSwatch(SwatchColor=RGB(105, 105, 105))  # disabled
material_2 = CreateMaterial(
    Diffuse=ColourSwatch(SwatchColor=RGB(0, 0, 0)),
    Specular=RGB(255, 255, 255),
    Emission=RGB(0, 0, 0),
    Transparency=0.5,
    Shine=0)
merge_7 = Merge(Data1=flatten(loop_start_2.Data_5), Data2=flatten(int_2))  # disabled

# ---- group: Joint_Inner
brep_14 = Brep(<brep referenced from the Rhino model>)

# ---- group: Joint_Nake
brep_15 = Brep(<brep referenced from the Rhino model>)

# ----
swatch_10 = ColourSwatch(SwatchColor=RGB(91, 118, 120))  # disabled

# ---- group: Component Design
toggle_3 = BooleanToggle(False)
xy = XYPlane(Origin=Point(0, 0, 0))
edges_2 = BrepEdges(Brep=brep_5)  # -> Naked, Interior, NonManifold
pflip_2 = FlipPlane(Plane=xy, ReverseX=Toggle(True), ReverseY=toggle_3, SwapAxes=toggle_3)
crv_28 = Curve(edges_2.Naked)

# ----
bbox_6 = BoundingBox(Content=crv_19, Plane=PlaneXY(0, 0, 0))  # -> Box, Box_2
bbox_7 = BoundingBox(Content=crv_20, Plane=PlaneXY(0, 0, 0))  # -> Box, Box_2
graft_9 = GraftTree(Tree=crv_19, IncludeEmptyLists=True, IncludeNullItems=True)
graft_10 = GraftTree(Tree=crv_20, IncludeEmptyLists=True, IncludeNullItems=True)
graft_11 = GraftTree(Tree=brep_4, IncludeEmptyLists=True, IncludeNullItems=True)  # -> simplify(Tree)
volume_3 = Volume(Geometry=brep_4)  # -> Volume, Centroid
area_3 = Area(Geometry=bbox_6.Box)  # -> Area, Centroid
area_4 = Area(Geometry=bbox_7.Box)  # -> Area, Centroid
scale_2 = Scale(Geometry=brep_4, Center=volume_3.Centroid, Factor=1.1)  # -> Geometry, Transform
brepinc_5 = PointInBrep(Brep=scale_2.Geometry, Point=graft(area_3.Centroid), Strict=False)
brepinc_6 = PointInBrep(Brep=scale_2.Geometry, Point=graft(area_4.Centroid), Strict=False)
# 01
boxprop_8 = BoxProperties(Box=graft_11)  # -> Center, Diagonal, Area, Volume, Degeneracy
tstat_7 = TreeStatistics(Tree=graft_9)  # -> Paths, Length, Count
tstat_8 = TreeStatistics(Tree=graft_10)  # -> Paths, Length, Count
lng_6 = ListLength(List=brep_4)
series_4 = Series(Start=0, Step=1, Count=lng_6)
cull_6 = CullPattern(List=series_4, CullPattern=brepinc_5)
flatten_6 = FlattenTree(Tree=cull_6, Path="{0}")
replace_5 = ReplacePaths(Data=graft_9, Search=tstat_7.Paths, Replace=flatten_6)
cull_7 = CullPattern(List=series_4, CullPattern=brepinc_6)
flatten_7 = FlattenTree(Tree=cull_7, Path="{0}")
replace_6 = ReplacePaths(Data=graft_10, Search=tstat_8.Paths, Replace=flatten_7)
python_5 = GhPythonScript(Poly=replace_5)  # -> out, Plane; inputs Poly: Curve; same code as python
python_6 = GhPythonScript(Poly=replace_6)  # -> out, Plane; inputs Poly: Curve; same code as python

# ---- group: Module centers
pt_6 = Point(boxprop_8.Center)

# ---- group: Module boxes
box_4 = Box(graft_11)

# ---- group: Incoming connectors
pln_8 = Plane(python_5.Plane)

# ---- group: Receiving connectors
pln_9 = Plane(python_6.Plane)

# ---- group: Component Design (continued)
orient_4 = Orient(Geometry=brep_7, Source=xy, Target=pln_8)  # -> Geometry, Transform
orient_5 = Orient(Geometry=brep_6, Source=pflip_2, Target=pln_9)  # -> Geometry, Transform
join_2 = BrepJoin(Breps=flatten([brep_5, orient_4.Geometry, orient_5.Geometry]))  # -> Breps, Closed
area_5 = Area(Geometry=join_2.Breps)  # -> Area, Centroid
pdecon_2 = Deconstruct(Point=area_5.Centroid)  # -> XComponent, YComponent, ZComponent
sort_2 = SortList(Keys=pdecon_2.XComponent, ValuesA=join_2.Breps)  # -> Keys, ValuesA
graft_12 = GraftTree(Tree=sort_2.ValuesA, IncludeEmptyLists=True, IncludeNullItems=True)  # -> simplify(Tree)

# ---- group: Component geometry
geo_7 = Geometry(graft_12)

# ----
edges_3 = BrepEdges(Brep=geo_7)  # -> Naked, Interior, NonManifold

preview_2 = CustomPreview(Geometry=geo_7, Material=material)
preview_3 = CustomPreview(Geometry=edges_3.Interior, Material=ColourSwatch(SwatchColor=RGB(0, 0, 0)))

panel_23 = Panel("1")  # disabled

# ---- group: Choose specific path
number_slider_15 = Slider(100, range=0..100)  # disabled
# 02
tstat_9 = TreeStatistics(Tree=pt_6)  # -> Paths, Length, Count; disabled

# ----
subtraction = Subtraction(A=tstat_9.Count, B=panel_23)  # disabled
dom = ConstructDomain(DomainStart=0, DomainEnd=subtraction)  # disabled

# ---- group: Choose specific path (continued)
random_7 = Random(Range=dom, Number=1, Seed=number_slider_15)  # disabled
int_3 = Integer(random_7)  # disabled
item_11 = ListItem(List=tstat_9.Paths, Index=int_3, Wrap=True)  # disabled

# ----
panel_24 = Panel(random_7)  # disabled

branch_9 = TreeBranch(Tree=pln_8, Path=item_11, MaintainPaths=False)  # disabled
branch_10 = TreeBranch(Tree=pln_9, Path=item_11, MaintainPaths=False)  # disabled
branch_11 = TreeBranch(Tree=geo_7, Path=item_11, MaintainPaths=False)  # disabled
number_slider_16 = Slider(95, range=0..100)  # disabled
lng_7 = ListLength(List=branch_9)  # disabled
random_8 = Random(Range=lng_7, Number=1, Seed=number_slider_16)  # disabled
item_12 = ListItem(List=branch_9, Index=random_8, Wrap=True)  # disabled
orient_6 = Orient(Geometry=branch_10, Source=item_12, Target=python_3.Plane)  # -> Geometry, Transform; disabled
orient_7 = Orient(Geometry=branch_11, Source=item_12, Target=python_3.Plane)  # -> Geometry, Transform; disabled

# ---- group: Replace RANDOM with something meaningful
number_slider_17 = Slider(1000, range=0..1000)  # disabled
number_slider_18 = Slider(1000, range=0..1000)  # disabled
number_slider_19 = Slider(1000, range=0..1000)  # disabled
random_9 = Random(Range=tstat_9.Count, Number=addition, Seed=number_slider_18)  # disabled
random_10 = Random(Range=Domain(0, 1), Number=addition, Seed=number_slider_19)  # disabled
random_11 = Random(Range=Domain(0, 1), Number=addition, Seed=number_slider_17)  # disabled

# ----
loop_start_3 = LoopStart(N=number_slider_2, T=button, D0=orient_7.Geometry, D1=orient_6.Geometry, D2=panel_9, D3=int_3)  # -> port, Counter, Data, Data_2, Data_3, Data_4; disabled

# ---- group: Placed geometries
geo_8 = Geometry(loop_start_3.Data)  # disabled

# ---- group: Available receiving connectors
pln_10 = Plane(loop_start_3.Data_2)  # disabled

# ---- group: Choosing next path
# 05
item_13 = ListItem(List=random_9, Index=loop_start_3.Counter, Wrap=True)  # disabled
int_4 = Integer(item_13)  # disabled
item_14 = ListItem(List=tstat_9.Paths, Index=int_4, Wrap=True)  # disabled

# ---- group: Next receiving connector
lng_8 = ListLength(List=pln_10)  # disabled
item_15 = ListItem(List=random_10, Index=loop_start_3.Counter, Wrap=True)  # disabled
multiplication_3 = Multiplication(A=lng_8, B=item_15)  # disabled
# 06
item_16 = ListItem(List=pln_10, Index=multiplication_3, Wrap=True)  # disabled

# ---- group: New Place Component
branch_12 = TreeBranch(Tree=pln_8, Path=item_14, MaintainPaths=False)  # disabled
branch_13 = TreeBranch(Tree=pln_9, Path=item_14, MaintainPaths=False)  # disabled
branch_14 = TreeBranch(Tree=geo_7, Path=item_14, MaintainPaths=False)  # disabled
item_17 = ListItem(List=random_11, Index=loop_start_3.Counter, Wrap=True)  # disabled
item_18 = ListItem(List=branch_12, Index=item_17, Wrap=True)  # disabled
orient_8 = Orient(Geometry=branch_13, Source=item_18, Target=item_16)  # -> Geometry, Transform; disabled
orient_9 = Orient(Geometry=branch_14, Source=item_18, Target=item_16)  # -> Geometry, Transform; disabled

# ---- group: New Place Component / New placed receiving connectors
pln_11 = Plane(orient_8.Geometry)  # disabled

# ---- group: New Place Component / New placed geometry
geo_9 = Geometry(orient_9.Geometry)  # disabled

# ----
preview_4 = CustomPreview(Geometry=geo_9, Material=swatch)  # disabled

number_slider_20 = Slider(0.5, range=0..1)  # disabled
mesh = MeshBrep(
    Brep=geo_9,
    Settings={GridMaxCount=0, GridMinCount=16, JaggedSeams=False, MaxEdgeLength=0, MinEdgeLength=0.0001, MinTolerance=0, Refine=True, RefineAngle=0, RelativeTolerance=0.65, SimplePlanes=True, Tolerance=0})  # disabled
mesh_2 = MeshBrep(
    Brep=geo_8,
    Settings={GridMaxCount=0, GridMinCount=16, JaggedSeams=False, MaxEdgeLength=0, MinEdgeLength=0.0001, MinTolerance=0, Refine=True, RefineAngle=0, RelativeTolerance=0.65, SimplePlanes=True, Tolerance=0})  # disabled
neg = Negative(Value=number_slider_20)  # disabled
wboffset = WeaverbirdsOffsetMesh(MeshCurves=mesh, Distance=neg, OffsetType=0)  # disabled
mmx = MeshMesh(MeshA=wboffset, MeshB=mesh_2, UseMeshMeshFast=True)  # -> flatten(Intersections); disabled
lng_9 = ListLength(List=mmx)  # disabled
bool_2 = Boolean(lng_9)  # disabled
not = GateNot(A=bool_2)  # disabled

# ---- group: Add new component to the list of components
merge_8 = Merge(Data1=pln_11, Data2=pln_10)  # -> flatten(Result); disabled
merge_9 = Merge(Data1=geo_9, Data2=geo_8)  # -> flatten(Result); disabled

# ---- group: Check if the new connector collides with existing non-connectors
pt_7 = Point(pln_11)  # disabled
pt_8 = Point(pln_10)  # disabled
dist_2 = Distance(PointA=graft(pt_7), PointB=pt_8)  # disabled
panel_25 = Panel("0.001")  # disabled
smaller_3 = SmallerThan(FirstNumber=dist_2, SecondNumber=panel_25)  # -> SmallerThan, OrEqualTo; disabled
flatten_8 = FlattenTree(Tree=smaller_3.SmallerThan, Path="{0}")  # disabled
ma_2 = MassAddition(Input=flatten_8)  # -> Result, PartialResults; disabled
bool_3 = Boolean(ma_2.Result)  # disabled
not_2 = GateNot(A=bool_3)  # disabled

# ---- group: Is the new component inside of the envelope?
pt_9 = Point(flatten(pln_11))  # disabled
brepinc_7 = PointInBrep(Brep=brep_10, Point=pt_9, Strict=False)  # disabled
int_5 = Integer(brepinc_7)  # disabled
lng_10 = ListLength(List=pt_9)  # disabled
ma_3 = MassAddition(Input=int_5)  # -> Result, PartialResults; disabled
equals = Equality(FirstNumber=lng_10, SecondNumber=ma_3.Result)  # -> Equality, Inequality; disabled

# ---- group: Remove used receiving connectors
cullpt = CullDuplicates(Points=merge_8, Tolerance=0.1, CullMode=2)  # -> Points, Indices, Valence; disabled
item_19 = ListItem(List=merge_8, Index=cullpt.Indices, Wrap=True)  # disabled

# ----
# 07
and = GateAnd(A=not_2, B=equals.Equality, C=not)  # disabled

# ---- group: Only keep the new component if no collision
filter_3 = StreamFilter(Gate=and, Stream0=pln_10, Stream1=item_19)  # disabled
filter_4 = StreamFilter(Gate=and, Stream0=geo_8, Stream1=merge_9)  # disabled

# ---- group: Placed receiving connectors
pln_12 = Plane(filter_3)  # disabled

# ---- group: Placed geometries
geo_10 = Geometry(filter_4)  # disabled

# ----
merge_10 = Merge(Data1=flatten(loop_start_3.Data_4), Data2=flatten(int_4))  # disabled
filter_5 = StreamFilter(Gate=and, Stream0=loop_start_3.Data_4, Stream1=merge_10)  # disabled
addition_4 = Addition(A=loop_start_3.Data_3, B=and)  # disabled
loop_end_2 = LoopEnd(
    port=loop_start_3.port,
    Exit=False,
    Data=geo_10,
    Data_2=pln_12,
    Data_3=addition_4,
    Data_4=filter_5,
    TimeOutVal=0,
    pausedState=False,
    state="Constant output")  # -> D0, D1, D2, D3; disabled
pln_13 = Plane(loop_end_2.D1)  # disabled
panel_26 = Panel(loop_end_2.D2)  # disabled
panel_27 = Panel(loop_end_2.D3)  # disabled

# ---- group: Placed geometries
geo_11 = Geometry(loop_end_2.D0)  # disabled

# ----
preview_5 = CustomPreview(Geometry=geo_11, Material=swatch_2)  # disabled

panel_28 = Panel("0")  # disabled
panel_29 = Panel("7")  # disabled
equals_2 = Equality(FirstNumber=loop_end_2.D3, SecondNumber=panel_28)  # -> Equality, Inequality; disabled
equals_3 = Equality(FirstNumber=loop_end_2.D3, SecondNumber=panel_29)  # -> Equality, Inequality; disabled
cull_8 = CullPattern(List=geo_11, CullPattern=equals_2.Equality)  # disabled
cull_9 = CullPattern(List=geo_11, CullPattern=equals_3.Equality)  # disabled

equals_4 = Equality(FirstNumber=loop_end_2.D3, SecondNumber=panel_17)  # -> Equality, Inequality; disabled
equals_5 = Equality(FirstNumber=loop_end_2.D3, SecondNumber=panel_18)  # -> Equality, Inequality; disabled
equals_6 = Equality(FirstNumber=loop_end_2.D3, SecondNumber=panel_19)  # -> Equality, Inequality; disabled
equals_7 = Equality(FirstNumber=loop_end_2.D3, SecondNumber=panel_20)  # -> Equality, Inequality; disabled
equals_8 = Equality(FirstNumber=loop_end_2.D3, SecondNumber=panel_21)  # -> Equality, Inequality; disabled
equals_9 = Equality(FirstNumber=loop_end_2.D3, SecondNumber=panel_22)  # -> Equality, Inequality; disabled
cull_10 = CullPattern(List=geo_11, CullPattern=equals_4.Equality)  # disabled
cull_11 = CullPattern(List=geo_11, CullPattern=equals_5.Equality)  # disabled
cull_12 = CullPattern(List=geo_11, CullPattern=equals_6.Equality)  # disabled
cull_13 = CullPattern(List=geo_11, CullPattern=equals_7.Equality)  # disabled
cull_14 = CullPattern(List=geo_11, CullPattern=equals_8.Equality)  # disabled
cull_15 = CullPattern(List=geo_11, CullPattern=equals_9.Equality)  # disabled
merge_11 = Merge(Data1=cull_8, Data2=cull_9)  # disabled
preview_6 = CustomPreview(Geometry=merge_11, Material=swatch_5)  # disabled
preview_7 = CustomPreview(Geometry=cull_10, Material=swatch_6)  # disabled
preview_8 = CustomPreview(Geometry=cull_11, Material=swatch_3)  # disabled
preview_9 = CustomPreview(Geometry=cull_12, Material=swatch_7)  # disabled
preview_10 = CustomPreview(Geometry=cull_13, Material=swatch_8)  # disabled
preview_11 = CustomPreview(Geometry=cull_14, Material=swatch_4)  # disabled
preview_12 = CustomPreview(Geometry=cull_15, Material=swatch_9)  # disabled

# ---- group: Choose specific path
# 02
tstat_10 = TreeStatistics(Tree=pt_3)  # -> Paths, Length, Count

# ----
subtraction_2 = Subtraction(A=tstat_10.Count, B="1")
dom_2 = ConstructDomain(DomainStart=0, DomainEnd=subtraction_2)

# ---- group: Choose specific path (continued)
random_12 = Random(Range=dom_2, Number=1, Seed=Slider(100, range=0..100))
int_6 = Integer(random_12)
item_20 = ListItem(List=tstat_10.Paths, Index=int_6, Wrap=True)

# ----
panel_30 = Panel(random_12)

branch_15 = TreeBranch(Tree=pln, Path=item_20, MaintainPaths=False)
branch_16 = TreeBranch(Tree=pln_2, Path=item_20, MaintainPaths=False)
branch_17 = TreeBranch(Tree=geo_4, Path=item_20, MaintainPaths=False)
lng_11 = ListLength(List=branch_15)
random_13 = Random(Range=lng_11, Number=1, Seed=Slider(95, range=0..100))
item_21 = ListItem(List=branch_15, Index=random_13, Wrap=True)
orient_10 = Orient(Geometry=branch_16, Source=item_21, Target=python_4.Plane)  # -> Geometry, Transform
orient_11 = Orient(Geometry=branch_17, Source=item_21, Target=python_4.Plane)  # -> Geometry, Transform

# ---- group: Replace RANDOM with something meaningful
random_14 = Random(Range=tstat_10.Count, Number=addition_2, Seed=Slider(1000, range=0..1000))
random_15 = Random(Range=Domain(0, 1), Number=addition_2, Seed=Slider(1000, range=0..1000))
random_16 = Random(Range=Domain(0, 1), Number=addition_2, Seed=Slider(1000, range=0..1000))

# ----
loop_start_4 = LoopStart(N=number_slider_3, T=Button(), D0=orient_11.Geometry, D1=orient_10.Geometry, D2="1", D3=int_6)  # -> port, Counter, Data, Data_2, Data_3, Data_4

# ---- group: Placed geometries
geo_12 = Geometry(loop_start_4.Data)

# ---- group: Available receiving connectors
pln_14 = Plane(loop_start_4.Data_2)

# ---- group: Choosing next path
# 05
item_22 = ListItem(List=random_14, Index=loop_start_4.Counter, Wrap=True)
int_7 = Integer(item_22)
item_23 = ListItem(List=tstat_10.Paths, Index=int_7, Wrap=True)

# ---- group: Next receiving connector
lng_12 = ListLength(List=pln_14)
item_24 = ListItem(List=random_15, Index=loop_start_4.Counter, Wrap=True)
multiplication_4 = Multiplication(A=lng_12, B=item_24)
# 06
item_25 = ListItem(List=pln_14, Index=multiplication_4, Wrap=True)

# ---- group: New Place Component
branch_18 = TreeBranch(Tree=pln, Path=item_23, MaintainPaths=False)
branch_19 = TreeBranch(Tree=pln_2, Path=item_23, MaintainPaths=False)
branch_20 = TreeBranch(Tree=geo_4, Path=item_23, MaintainPaths=False)
item_26 = ListItem(List=random_16, Index=loop_start_4.Counter, Wrap=True)
item_27 = ListItem(List=branch_18, Index=item_26, Wrap=True)
orient_12 = Orient(Geometry=branch_19, Source=item_27, Target=item_25)  # -> Geometry, Transform
orient_13 = Orient(Geometry=branch_20, Source=item_27, Target=item_25)  # -> Geometry, Transform

# ---- group: New Place Component / New placed receiving connectors
pln_15 = Plane(orient_12.Geometry)

# ---- group: New Place Component / New placed geometry
geo_13 = Geometry(orient_13.Geometry)

# ----
preview_13 = CustomPreview(Geometry=geo_13, Material=ColourSwatch(SwatchColor=RGB(109, 187, 252)))

# ---- group: Check if the new connector collides with existing non-connectors
pt_10 = Point(pln_15)
pt_11 = Point(pln_14)
dist_3 = Distance(PointA=graft(pt_10), PointB=pt_11)
smaller_4 = SmallerThan(FirstNumber=dist_3, SecondNumber="0.001")  # -> SmallerThan, OrEqualTo
flatten_9 = FlattenTree(Tree=smaller_4.SmallerThan, Path="{0}")
ma_4 = MassAddition(Input=flatten_9)  # -> Result, PartialResults
bool_4 = Boolean(ma_4.Result)
not_3 = GateNot(A=bool_4)

# ---- group: Is the new component inside of the envelope?
pt_12 = Point(flatten(pln_15))
brepinc_8 = PointInBrep(Brep=brep_11, Point=pt_12, Strict=False)
int_8 = Integer(brepinc_8)
lng_13 = ListLength(List=pt_12)
ma_5 = MassAddition(Input=int_8)  # -> Result, PartialResults
# 07
equals_10 = Equality(FirstNumber=lng_13, SecondNumber=ma_5.Result)  # -> Equality, Inequality

# ---- group: Point Collison
ungroup_3 = Ungroup(Group=geo_13)
ungroup_4 = Ungroup(Group=geo_12)
item_28 = ListItem(List=ungroup_3, Index=0, Wrap=True)
item_29 = ListItem(List=ungroup_4, Index=0, Wrap=True)  # -> flatten(Item)
ungroup_5 = Ungroup(Group=item_29)
ungroup_6 = Ungroup(Group=item_28)
ln = Line(StartPoint=ungroup_6, EndPoint=ungroup_5)  # -> simplify(Line)
smaller_5 = SmallerThan(FirstNumber=ln, SecondNumber="0.001")  # -> SmallerThan, OrEqualTo
flatten_10 = FlattenTree(Tree=smaller_5.SmallerThan, Path="{0}")  # -> flatten(Tree)
ma_6 = MassAddition(Input=flatten_10)  # -> Result, PartialResults
bool_5 = Boolean(ma_6.Result)
not_4 = GateNot(A=bool_5)

# ----
ungroup_7 = Ungroup(Group=geo_13)
ungroup_8 = Ungroup(Group=geo_12)
item_30 = ListItem(List=ungroup_7, Index=panel_15, Wrap=True)
item_31 = ListItem(List=ungroup_8, Index=panel_15, Wrap=True)  # -> flatten(Item)

# ---- group: Add new component to the list of components
merge_12 = Merge(Data1=pln_15, Data2=pln_14)  # -> flatten(Result)
merge_13 = Merge(Data1=geo_13, Data2=geo_12)  # -> flatten(Result)

# ----
ungroup_9 = Ungroup(Group=item_31)
ungroup_10 = Ungroup(Group=item_30)
mesh_3 = MeshBrep(
    Brep=ungroup_10,
    Settings={GridMaxCount=0, GridMinCount=16, JaggedSeams=False, MaxEdgeLength=0, MinEdgeLength=0.0001, MinTolerance=0, Refine=True, RefineAngle=0, RelativeTolerance=0.65, SimplePlanes=True, Tolerance=0})

neg_2 = Negative(Value=Slider(0.5, range=0..1))
wboffset_2 = WeaverbirdsOffsetMesh(MeshCurves=mesh_3, Distance=neg_2, OffsetType=0)

mesh_4 = MeshBrep(
    Brep=ungroup_9,
    Settings={GridMaxCount=0, GridMinCount=16, JaggedSeams=False, MaxEdgeLength=0, MinEdgeLength=0.0001, MinTolerance=0, Refine=True, RefineAngle=0, RelativeTolerance=0.65, SimplePlanes=True, Tolerance=0})

# ---- group: Remove used receiving connectors
cullpt_2 = CullDuplicates(Points=merge_12, Tolerance=0.1, CullMode=2)  # -> Points, Indices, Valence
item_32 = ListItem(List=merge_12, Index=cullpt_2.Indices, Wrap=True)

# ----
mmx_2 = MeshMesh(MeshA=wboffset_2, MeshB=mesh_4, UseMeshMeshFast=True)  # -> flatten(Intersections)
lng_14 = ListLength(List=mmx_2)
bool_6 = Boolean(lng_14)
not_5 = GateNot(A=bool_6)
merge_14 = Merge(Data1=flatten(loop_start_4.Data_4), Data2=flatten(int_7))
and_2 = GateAnd(A=not_3, B=equals_10.Equality, C=not_4)

# ---- group: Only keep the new component if no collision
filter_6 = StreamFilter(Gate=and_2, Stream0=pln_14, Stream1=item_32)
filter_7 = StreamFilter(Gate=and_2, Stream0=geo_12, Stream1=merge_13)

# ---- group: Placed receiving connectors
pln_16 = Plane(filter_6)

# ---- group: Placed geometries
geo_14 = Geometry(filter_7)

# ----
filter_8 = StreamFilter(Gate=and_2, Stream0=loop_start_4.Data_4, Stream1=merge_14)
addition_5 = Addition(A=loop_start_4.Data_3, B=and_2)
# <<<<< This ONE
panel_31 = Panel(and_2)
loop_end_3 = LoopEnd(
    port=loop_start_4.port,
    Exit=False,
    Data=geo_14,
    Data_2=pln_16,
    Data_3=addition_5,
    Data_4=filter_8,
    TimeOutVal=0,
    pausedState=False,
    state="Constant output")  # -> D0, D1, D2, D3
pln_17 = Plane(loop_end_3.D1)
panel_32 = Panel(loop_end_3.D2)
panel_33 = Panel(loop_end_3.D3)

# ---- group: Placed geometries
geo_15 = Geometry(loop_end_3.D0)

# ----
ungroup_11 = Ungroup(Group=geo_15)
item_33 = ListItem(List=ungroup_11, Index=0, Wrap=True)  # -> Item, Item1, Item2, Item3, Item4, Item5, Item6, Item7, Item8, Item9
cull_i_2 = CullIndex(List=ungroup_11, Indices=panel_16, Wrap=True)
crv_29 = Curve(flatten(item_33.Item7))
crv_30 = Curve(flatten(item_33.Item8))
crv_31 = Curve(flatten(item_33.Item5))
crv_32 = Curve(flatten(item_33.Item6))
crv_33 = Curve(flatten(item_33.Item3))
crv_34 = Curve(flatten(item_33.Item4))
srf_10 = Surface(flatten(item_33.Item1))
srf_11 = Surface(flatten(item_33.Item2))
ungroup_12 = Ungroup(Group=item_33.Item)
tstat_11 = TreeStatistics(Tree=ungroup_12)  # -> Paths, Length, Count
boundary = BoundarySurfaces(Edges=graft(crv_29))
boundary_2 = BoundarySurfaces(Edges=graft(crv_30))
ungroup_13 = Ungroup(Group=item_33.Item9)  # -> flatten(Objects)
preview_14 = CustomPreview(Geometry=[srf_10, srf_11], Material=ColourSwatch(SwatchColor=RGB(255, 255, 255)))
preview_15 = CustomPreview(Geometry=[crv_33, crv_34], Material=ColourSwatch(SwatchColor=RGB(0, 255, 255)))
preview_16 = CustomPreview(Geometry=[crv_31, crv_32], Material=ColourSwatch(SwatchColor=RGB(255, 0, 255)))
equals_11 = Equality(FirstNumber=tstat_11.Length, SecondNumber="8")  # -> Equality, Inequality
area_6 = Area(Geometry=ungroup_13)  # -> Area, Centroid
area_7 = Area(Geometry=boundary)  # -> Area, flatten(Centroid)
eval = EvaluateCurve(Curve=reparameterize(crv_29), Parameter="0.5")  # -> flatten(Point), Tangent, Angle
area_8 = Area(Geometry=boundary_2)  # -> Area, flatten(Centroid)
eval_2 = EvaluateCurve(Curve=reparameterize(crv_30), Parameter="0.5")  # -> flatten(Point), Tangent, Angle
sift = SiftPattern(List=simplify(ungroup_12), SiftPattern=equals_11.Equality)  # -> Output0, Output1
project = Project(Geometry=area_6.Centroid, Plane=graft(debrep_2.Faces))  # -> Geometry, Transform
edges_4 = BrepEdges(Brep=[srf_10, srf_11])  # -> Naked, Interior, NonManifold
pdecon_3 = Deconstruct(Point=area_7.Centroid)  # -> XComponent, YComponent, ZComponent
pdecon_4 = Deconstruct(Point=eval.Point)  # -> XComponent, YComponent, ZComponent
pdecon_5 = Deconstruct(Point=area_8.Centroid)  # -> XComponent, YComponent, ZComponent
pdecon_6 = Deconstruct(Point=eval_2.Point)  # -> XComponent, YComponent, ZComponent
pt_13 = Point(sift.Output0)
pt_14 = Point(sift.Output1)
ln_2 = Line(StartPoint=area_6.Centroid, EndPoint=project.Geometry)
preview_17 = CustomPreview(Geometry=edges_4.Naked, Material=material_2)
subtraction_3 = Subtraction(A=pdecon_3.ZComponent, B=pdecon_4.ZComponent)
subtraction_4 = Subtraction(A=pdecon_5.ZComponent, B=pdecon_6.ZComponent)
flip = FlipMatrix(Data=ln_2)
abs_2 = Absolute(Value=subtraction_3)
abs_3 = Absolute(Value=subtraction_4)
item_34 = ListItem(List=flip, Index=0, Wrap=True)  # -> flatten(Item), flatten(Item1), flatten(Item2), flatten(Item3), flatten(Item4), flatten(Item5)
larger_2 = LargerThan(FirstNumber=abs_2, SecondNumber="0.01")  # -> LargerThan, OrEqualTo
larger_3 = LargerThan(FirstNumber=abs_3, SecondNumber="0.01")  # -> LargerThan, OrEqualTo
dispatch_2 = Dispatch(List=crv_29, DispatchPattern=larger_2.LargerThan)  # -> ListA, ListB
dispatch_3 = Dispatch(List=crv_30, DispatchPattern=larger_3.LargerThan)  # -> ListA, ListB
crv_35 = Curve(graft(dispatch_2.ListA))
crv_36 = Curve(graft(dispatch_2.ListB))
crv_37 = Curve(graft(dispatch_3.ListA))
crv_38 = Curve(graft(dispatch_3.ListB))
smaller_6 = SmallerThan(FirstNumber=item_34.Item, SecondNumber="5")  # -> SmallerThan, OrEqualTo
smaller_7 = SmallerThan(FirstNumber=item_34.Item1, SecondNumber="5")  # -> SmallerThan, OrEqualTo
smaller_8 = SmallerThan(FirstNumber=item_34.Item2, SecondNumber="5")  # -> SmallerThan, OrEqualTo
smaller_9 = SmallerThan(FirstNumber=item_34.Item3, SecondNumber="5")  # -> SmallerThan, OrEqualTo
smaller_10 = SmallerThan(FirstNumber=item_34.Item4, SecondNumber="5")  # -> SmallerThan, OrEqualTo
smaller_11 = SmallerThan(FirstNumber=item_34.Item5, SecondNumber="5")  # -> SmallerThan, OrEqualTo

# ---- group: Vertical
boundary_3 = BoundarySurfaces(Edges=crv_35)

# ---- group: Horizantal
boundary_4 = BoundarySurfaces(Edges=crv_36)

# ---- group: Vertical
boundary_5 = BoundarySurfaces(Edges=crv_37)

# ---- group: Horizantal
boundary_6 = BoundarySurfaces(Edges=crv_38)

# ----
or = GateOr(
    A=smaller_6.SmallerThan,
    B=smaller_7.SmallerThan,
    C=smaller_8.SmallerThan,
    E=smaller_9.SmallerThan,
    F=smaller_10.SmallerThan,
    D=smaller_11.SmallerThan)
srf_12 = Surface([boundary_3, boundary_5])
srf_13 = Surface([boundary_6, boundary_4])
cull_16 = CullPattern(List=ungroup_13, CullPattern=or)
cull_17 = CullPattern(List=ungroup_13, CullPattern=invert(or))
preview_18 = CustomPreview(Geometry=srf_12, Material=ColourSwatch(SwatchColor=RGB(197, 243, 0)))
preview_19 = CustomPreview(Geometry=srf_13, Material=ColourSwatch(SwatchColor=RGB(140, 224, 119)))
area_9 = Area(Geometry=cull_17)  # -> Area, Centroid
evalsrf_2 = EvaluateSurface(Surface=reparameterize(cull_17), Point=area_9.Centroid)  # -> Point, Normal, UDirection, VDirection, Frame
pl_2 = PlaneNormal(Origin=area_9.Centroid, ZAxis=evalsrf_2.Normal)

toggle_4 = BooleanToggle(False)
xy_2 = XYPlane(Origin=Point(0, 0, 0))
pflip_3 = FlipPlane(Plane=xy_2, ReverseX=Toggle(True), ReverseY=toggle_4, SwapAxes=toggle_4)
orient_14 = Orient(Geometry=brep_14, Source=xy_2, Target=pl_2)  # -> Geometry, Transform
orient_15 = Orient(Geometry=brep_15, Source=pflip_3, Target=pl_2)  # -> Geometry, Transform

edges_5 = BrepEdges(Brep=orient_14.Geometry)  # -> Naked, Interior, NonManifold

# ---- group: Ask Soroush
sift_2 = SiftPattern(List=ungroup_13, SiftPattern=smaller_6.SmallerThan)  # -> Output0, Output1
srf_14 = Surface(sift_2.Output0)
srf_15 = Surface(sift_2.Output1)
null = NullItem(Item=sift_2.Output1)  # -> NullFlags, InvalidFlags, Description
panel_34 = Panel(sift_2.Output1)

# ----
preview_20 = CustomPreview(Geometry=edges_5.Interior, Material=ColourSwatch(SwatchColor=RGB(0, 0, 0)))
preview_21 = CustomPreview(Geometry=orient_14.Geometry, Material=ColourSwatch(SwatchColor=RGB(243, 253, 255)))

# ---- group: New Place Component
item_35 = ListItem(List=random_5, Index=loop_start_2.Counter, Wrap=True)  # disabled
multiplication_5 = Multiplication(B=item_35)  # disabled

# ---- group: New Place Component / Next receiving connector
# 06
item_36 = ListItem(List=branch_5, Index=multiplication_5, Wrap=True)  # disabled

# ---- group: New Place Component (continued)
orient_16 = Orient(Geometry=branch_7, Source=item_36, Target=item_10)  # -> Geometry, Transform; disabled
orient_17 = Orient(Geometry=branch_6, Source=item_36, Target=item_10)  # -> Geometry, Transform; disabled
orient_18 = Orient(Geometry=branch_8, Source=item_36, Target=item_10)  # -> Geometry, Transform; disabled

# ---- group: New Place Component / New placed geometry
geo_16 = Geometry(orient_17.Geometry)  # disabled

# ---- group: New Place Component / New placed receiving connectors
pln_18 = Plane(orient_16.Geometry)  # disabled

# ---- group: New Place Component / New placed unavailable receiving connectors
pln_19 = Plane(orient_18.Geometry)  # disabled

# ---- group: Check if the new connector collides with existing non-connectors
pt_15 = Point(pln_18)  # disabled
pt_16 = Point(pln_7)  # disabled
dist_4 = Distance(PointA=graft(pt_15), PointB=pt_16)  # disabled
panel_35 = Panel("0.001")  # disabled
smaller_12 = SmallerThan(FirstNumber=dist_4, SecondNumber=panel_35)  # -> SmallerThan, OrEqualTo; disabled
flatten_11 = FlattenTree(Tree=smaller_12.SmallerThan, Path="{0}")  # disabled
ma_7 = MassAddition(Input=flatten_11)  # -> Result, PartialResults; disabled
bool_7 = Boolean(ma_7.Result)  # disabled
not_6 = GateNot(A=bool_7)  # disabled

# ---- group: Check if the new non-connector collides with existing connectors
pt_17 = Point(pln_19)  # disabled
pt_18 = Point(pln_6)  # disabled
dist_5 = Distance(PointA=graft(pt_17), PointB=pt_18)  # disabled
panel_36 = Panel("0.001")  # disabled
smaller_13 = SmallerThan(FirstNumber=dist_5, SecondNumber=panel_36)  # -> SmallerThan, OrEqualTo; disabled
flatten_12 = FlattenTree(Tree=smaller_13.SmallerThan, Path="{0}")  # disabled
ma_8 = MassAddition(Input=flatten_12)  # -> Result, PartialResults; disabled
bool_8 = Boolean(ma_8.Result)  # disabled
not_7 = GateNot(A=bool_8)  # disabled

# ---- group: Is the new component inside of the envelope?
pt_19 = Point(flatten([pln_18, pln_19]))  # disabled
brepinc_9 = PointInBrep(Brep=brep_12, Point=pt_19, Strict=False)  # disabled
int_9 = Integer(brepinc_9)  # disabled
lng_15 = ListLength(List=pt_19)  # disabled
ma_9 = MassAddition(Input=int_9)  # -> Result, PartialResults; disabled
equals_12 = Equality(FirstNumber=lng_15, SecondNumber=ma_9.Result)  # -> Equality, Inequality; disabled

# ---- group: Add new component to the list of components
merge_15 = Merge(Data1=geo_16, Data2=geo_6)  # -> flatten(Result); disabled
merge_16 = Merge(Data1=pln_18, Data2=pln_6)  # -> flatten(Result); disabled
merge_17 = Merge(Data1=pln_19, Data2=pln_7)  # -> flatten(Result); disabled

# ---- group: Remove used receiving connectors
cullpt_3 = CullDuplicates(Points=merge_16, Tolerance=0.1, CullMode=2)  # -> Points, Indices, Valence; disabled
item_37 = ListItem(List=merge_16, Index=cullpt_3.Indices, Wrap=True)  # disabled

# ---- group: Remove duplicate non-connectors
cullpt_4 = CullDuplicates(Points=merge_17, Tolerance=0.1, CullMode=2)  # -> Points, Indices, Valence; disabled
item_38 = ListItem(List=merge_17, Index=cullpt_4.Indices, Wrap=True)  # disabled

# ----
# 07
and_3 = GateAnd(A=not_6, B=not_7, C=equals_12.Equality)  # disabled

# ---- group: Only keep the new component if no collision
filter_9 = StreamFilter(Gate=and_3, Stream0=geo_6, Stream1=merge_15)  # disabled
filter_10 = StreamFilter(Gate=and_3, Stream0=pln_6, Stream1=item_37)  # disabled
filter_11 = StreamFilter(Gate=and_3, Stream0=pln_7, Stream1=item_38)  # disabled

# ----
filter_12 = StreamFilter(Gate=and_3, Stream0=loop_start_2.Data_5, Stream1=merge_7)  # disabled
addition_6 = Addition(A=loop_start_2.Data_4, B=and_3)  # disabled

# ---- group: Placed receiving connectors
pln_20 = Plane(filter_10)  # disabled

# ---- group: Placed unavailable receiving connectors
pln_21 = Plane(filter_11)  # disabled

# ---- group: Placed geometries
geo_17 = Geometry(filter_9)  # disabled

# ----
loop_end_4 = LoopEnd(
    port=loop_start_2.port,
    Exit=False,
    Data=geo_17,
    Data_2=pln_20,
    Data_3=pln_21,
    Data_4=addition_6,
    Data_5=filter_12,
    TimeOutVal=0,
    pausedState=False,
    state="Constant output")  # -> D0, D1, D2, D3, D4; disabled
panel_37 = Panel(loop_end_4.D3)  # disabled
panel_38 = Panel(loop_end_4.D4)  # disabled

# ---- group: Placed geometries
geo_18 = Geometry(loop_end_4.D0)  # disabled

# ----
preview_22 = CustomPreview(Geometry=geo_18, Material=swatch_10)  # disabled
